# Grasshopper definition gh-test.gh (Grasshopper 1.0.7)
# plug-ins: Tracker

natnet_listener = SimpleNatNetListener(Activate=Toggle(False), LocalIP="127.0.0.1", ServerIP="127.0.0.1", SampleRate=Slider(1, range=1..5))  # -> Status, Data
split = TextSplit(Text=natnet_listener.Data, Separators="=()")
item = ListItem(List=split, Index=Slider(2, range=0..10), Wrap=True)
panel = Panel(split)
pt = Point(item)
rec = DataRecorder(pt, DataLimit=-10, RecordData=True)
pline = PolyLine(Vertices=rec, Closed=False)
